# Grasshopper definition NODEMaple Grasshopper.gh (Grasshopper 1.0.8)

nodemaple_materialdefinitions = Python3Script()  # -> categories, members_tree, metadata_tree, debug
# ---------- nodemaple_materialdefinitions: Python ----------
"""
NODEMaple Material Data — Levels 2 & 3 (tree output)
Queries grade lists ("allmembers") and property definitions ("metadata")
for all material categories in a single Maple process, and returns them
as Grasshopper data trees whose branches correspond to categories.

For steel: grades include standard code (e.g. "S 275 H@NS-EN 10210-1")
to disambiguate grades that appear under multiple standards.

The branch order matches the order reported by NODEFunctions:-Materials(),
so a branch index is valid simultaneously in both trees.

Input:
  maple_version : Maple year, e.g. "2026" (ignored if MAPLE env var is set)

Output:
  members_tree  : tree, branch per category -> list of grade names
  metadata_tree : tree, branch per category -> list of property names
  categories    : ordered list of category names (branch keys, human-readable)
  debug         : raw Maple output; also shows SKIP|<category> lines
"""
import os
import subprocess
import Grasshopper
from Grasshopper.Kernel.Data import GH_Path

# ---------------------------------------------------------------------------
# Configuration
# ---------------------------------------------------------------------------
if os.environ.get("MAPLE"):
    MAPLE_ROOT = os.environ["MAPLE"]
else:
    MAPLE_ROOT = os.path.join(r"C:\Program Files", f"Maple {maple_version}")

MAPLE_PATH = os.path.join(MAPLE_ROOT, "bin.X86_64_WINDOWS", "cmaple.exe")

def run_maple_script(script, timeout=30):
    """Run a Maple script in a fresh cmaple process and return its output."""
    env = dict(os.environ)
    env["MAPLE"] = MAPLE_ROOT
    env["PATH"] = os.path.join(MAPLE_ROOT, "bin.X86_64_WINDOWS") + \
        os.pathsep + env.get("PATH", "")

    proc = subprocess.Popen(
        [MAPLE_PATH, "-q"],
        stdin=subprocess.PIPE, stdout=subprocess.PIPE,
        stderr=subprocess.STDOUT, text=True,
        cwd=os.path.join(MAPLE_ROOT, "bin.X86_64_WINDOWS"),
        env=env,
        creationflags=subprocess.CREATE_NO_WINDOW)

    out, _ = proc.communicate(input=script, timeout=timeout)
    return out

def query_material_data():
    """Fetch categories, grades and metadata in one Maple process.

    For STEEL: outputs CODE@GRADE combinations to disambiguate
    grades appearing under multiple standards (e.g. "S 275 H@NS-EN 10210-1").
    
    Emits: CAT|<category>          once per category, in order
           LIST|mem|<category>|<grade>
           LIST|meta|<category>|<property>
           SKIP|<category>         for unmapped categories

    NOTE: every Maple statement is terminated with ":" or ";".
    Omitting a terminator lets the parser swallow the following line
    (e.g. an inline if-expression), producing misleading syntax errors.
    """
    script_lines = [
        "kernelopts(printbytes=false):",
        "interface(prettyprint=0):",
        '# Category -> module mapping',
        'nodetab := table(["steel"    = NODESteelMaterial,',
        '                  "timber"   = NODETimberMaterial,',
        '                  "concrete" = NODEConcreteMaterial]):',
        '# Categories are discovered at runtime',
        "cats := NODEFunctions:-Materials():",
        "known := [indices(nodetab, 'nolist')]:",
        "for c in cats do",
        '  printf("CAT|%s\\n", c):',
        "  if member(c, known) then",
        "    M := nodetab[c]:",
        '# Steel: special handling for code-grade pairs',
        '  if c = "steel" then',
        '# First get all codes',
        '    codes := M:-Property("allcodes"):',
        '    for code in codes do',
        '# Then grades of this code',
        '      for g in M:-Property(code,"allmembers") do',
        '# Composite grade name: grade@code',
        '        fullname := cat(g,"@",code):',
        '        printf("LIST|mem|%s|%s\\n", c, fullname):',
        "      end do:",
        "    end do:",
        "  else:",
        '# Non-steel: simple grade list',
        '    for e in M:-Property("allmembers") do',
        '      printf("LIST|mem|%s|%s\\n", c, e):',
        "    end do:",
        "  end if:",
        '# Metadata is always simple list',
        '    for e in M:-Property("metadata") do',
        '      printf("LIST|meta|%s|%s\\n", c, e):',
        "    end do:",
        "  else",
        '    printf("SKIP|%s\\n", c):',
        "  end if:",
        "end do:",
        "quit:",
    ]
    return run_maple_script("\n".join(script_lines) + "\n")

# ---------------------------------------------------------------------------
# Main execution
# ---------------------------------------------------------------------------
raw = query_material_data()

categories = []                 # ordered category names (= branch keys)
members_by_cat = {}             # {"timber": [grades...]}
metadata_by_cat = {}            # {"timber": [properties...]}

for line in raw.splitlines():
    s = line.strip()
    if s.startswith("CAT|"):
        cat = s.split("|", 1)[1].strip()
        if cat:
            categories.append(cat)
            members_by_cat.setdefault(cat, [])
            metadata_by_cat.setdefault(cat, [])
    elif s.startswith("LIST|mem|"):
        parts = s.split("|", 3)
        if len(parts) == 4:
            _, kind, cat, entry = parts
            entry = entry.strip().strip('"')
            if entry:
                members_by_cat.setdefault(cat, []).append(entry)
    elif s.startswith("LIST|meta|"):
        parts = s.split("|", 3)
        if len(parts) == 4:
            _, kind, cat, entry = parts
            entry = entry.strip().strip('"')
            if entry:
                metadata_by_cat.setdefault(cat, []).append(entry)

# Build the trees — GH1 recipe
members_tree = Grasshopper.DataTree[object]()
metadata_tree = Grasshopper.DataTree[object]()

for i, cat in enumerate(categories):
    path = GH_Path(i)
    members_tree.AddRange(members_by_cat.get(cat, []), path)
    metadata_tree.AddRange(metadata_by_cat.get(cat, []), path)

debug = raw
# ---------- end nodemaple_materialdefinitions ----------
vl_material = ValueList({"steel": 0, "timber": 1, "concrete": 2}, selected="concrete")
populate_valuelist = Python3Script(list_name="VL_material", names=nodemaple_materialdefinitions.categories)  # -> out, a; inputs list_name: String, names: list of String, values: list of String
# ---------- populate_valuelist: Python ----------
import Grasshopper as gh
from Grasshopper.Kernel.Special import GH_ValueListItem

doc = ghenv.Component.OnPingDocument()

# list_name og names må alltid være definert
if doc and list_name and names:
    
    # 1. Finn Value List på lerretet basert på Nickname
    target_list = None
    for obj in doc.Objects:
        if isinstance(obj, gh.Kernel.Special.GH_ValueList) and obj.NickName == list_name:
            target_list = obj
            break

    if target_list:
        formatted_items = []
        has_custom_values = bool(values and len(values) > 0)

        for i, name in enumerate(names):
            n = str(name).strip()
            
            if has_custom_values and i < len(values):
                # Bruk oppgitt verdi fra 'values'
                val_raw = str(values[i]).strip()
                try:
                    float(val_raw)
                    expr = val_raw
                except ValueError:
                    expr = '"{}"'.format(val_raw)
            else:
                # Fallback: Bruk listenummer / indeks som heltall
                expr = str(i)

            formatted_items.append((n, expr))

        # Kontroller gjeldende tilstand for å unngå unødvendig oppdatering
        current_state = [(item.Name, item.Expression) for item in target_list.ListItems]
        
        if current_state != formatted_items:
            def update_callback(d):
                target_list.ListItems.Clear()
                for n, expr in formatted_items:
                    target_list.ListItems.Add(GH_ValueListItem(n, expr))
                
                target_list.Attributes.ExpireLayout()
                target_list.ExpireSolution(False)

            doc.ScheduleSolution(1, gh.Kernel.GH_Document.GH_ScheduleDelegate(update_callback))
# ---------- end populate_valuelist ----------
tree_branch = TreeBranch(Tree=nodemaple_materialdefinitions.members_tree, Path=vl_material, MaintainPaths=True)
tree_branch_2 = TreeBranch(Tree=nodemaple_materialdefinitions.metadata_tree, Path=vl_material, MaintainPaths=True)
panel = Panel(nodemaple_materialdefinitions.categories)
panel_2 = Panel(nodemaple_materialdefinitions.metadata_tree)
vl_material_2 = ValueList({"steel": 0, "timber": 1, "concrete": 2}, selected="concrete")
panel_3 = Panel(nodemaple_materialdefinitions.members_tree)
panel_4 = Panel(tree_branch_2)
panel_5 = Panel(tree_branch)
list_item = ListItem(List=nodemaple_materialdefinitions.categories, Index=vl_material, Wrap=True)
vl_grade = ValueList({"B10": 0, "B20": 1, "B25": 2, "B30": 3, "B35": 4, "B45": 5, "B55": 6, "B65": 7, "B75": 8, "B85": 9, "B95": 10, "LB12": 11, "LB20": 12, "LB25": 13, "LB30": 14, "LB35": 15, "LB45": 16, "LB55": 17, "LB65": 18, "LB75": 19}, selected="B35")
material_grade_picker = Python3Script(
    categories=nodemaple_materialdefinitions.categories,
    members_tree=nodemaple_materialdefinitions.members_tree,
    cat_index=vl_material_2,
    grade_index=vl_grade)  # -> category, grade, count, debug; inputs categories: list, members_tree: tree; disabled
# ---------- material_grade_picker: Python ----------
"""
Grade Picker
Selects a grade name from the members tree by category index + item index.

Input:
  members_tree : tree from NODEMaple Material Definitions (Tree Access)
  categories   : list from the same component (List Access!)
  cat_index    : category index slider, 0 .. len(categories)-1
  grade_index  : grade index slider, 0 .. count-1

Output:
  grade    : selected grade name, e.g. "C24", "S 235", "B30"
  category : name of the chosen category (wire to property fetcher)
  count    : number of grades in the chosen category
  debug    : trace of the resolution for troubleshooting
"""
categories_list = [str(c) for c in categories] if categories else []

cat_idx = int(cat_index)
grade_idx = int(grade_index)

grade = None
category = None
count = 0

if 0 <= cat_idx < len(categories_list):
    category = categories_list[cat_idx]
    branch = members_tree.Branch(cat_idx)
    count = len(branch)

    # Clamp: sliders can't limit their own range (see README), so the
    # picker tolerates oversized indices instead of returning null.
    grade_idx = min(grade_idx, count - 1)

    if 0 <= grade_idx < count:
        grade = str(branch[grade_idx])
        debug = "Branch {%d} = %s -> item %d = %s" % (
            cat_idx, category, grade_idx, grade)
    else:
        debug = "Empty branch for category '%s'" % category
else:
    debug = "Warning: cat_index %d out of range (max %d)" % (
        cat_idx, len(categories_list) - 1)
# ---------- end material_grade_picker ----------
populate_valuelist_2 = Python3Script(list_name="VL_grade", names=panel_5)  # -> out, a; inputs list_name: String, names: list of String, values: list of String; same code as populate_valuelist
tree_branch_3 = TreeBranch(Tree=nodemaple_materialdefinitions.members_tree, Path=vl_material_2, MaintainPaths=True)
list_item_2 = ListItem(List=panel_5, Index=vl_grade, Wrap=True)
panel_6 = Panel(list_item_2)
panel_7 = Panel(tree_branch_3)
panel_8 = Panel(list_item)
panel_9 = Panel(material_grade_picker.debug)
panel_10 = Panel(panel_4)
python_3_script = Python3Script(category=panel_8, grade=panel_6, prop_names=panel_10)  # -> values, units, texts, table, debug; inputs prop_names: list
# ---------- python_3_script: Python ----------
"""
NODEMaple Retrieve All Properties
Fetches ALL property values for a SINGLE material grade in one Maple process.

Workflow:
  material -> grade -> variables -> values

Accepts the variable list from the metadata branch (or any list of
property names). Returns parallel lists, so values[i] / units[i] /
texts[i] all belong to names_in[i].

Steel: use the composite grade "S 275 H@NS-EN 10210-1" to select the
standard; the "@code" suffix is split off and passed as the 3rd
Property argument.

Input:
  category      : "steel", "timber", "concrete"
  grade         : e.g. "C24", "S 275 H@NS-EN 10210-1"
  prop_names    : list of property names to fetch (List Access!)
  maple_version : Maple year, e.g. "2026" (ignored if MAPLE env var is set)

Output:
  names_in : echo of the requested property names (ordered)
  values   : parallel list of numeric values (None for text properties)
  units    : parallel list of unit strings ("" where none)
  texts    : parallel list of text values (None for numeric properties)
  table    : display list, "name = value unit" one line per property
  debug    : raw Maple output, preceded by a send/receive summary

NOTE: the Maple<->Python protocol is ASCII-only ("|" as field separator).
Non-ASCII separators do not survive the cmaple stdin/stdout round trip.
"""
import os
import subprocess

# ---------------------------------------------------------------------------
# Configuration
# ---------------------------------------------------------------------------
if os.environ.get("MAPLE"):
    MAPLE_ROOT = os.environ["MAPLE"]
else:
    MAPLE_ROOT = os.path.join(r"C:\Program Files", f"Maple {maple_version}")

MAPLE_PATH = os.path.join(MAPLE_ROOT, "bin.X86_64_WINDOWS", "cmaple.exe")

def run_maple_script(script, timeout=60):
    """Run a Maple script in a fresh cmaple process and return its output."""
    env = dict(os.environ)
    env["MAPLE"] = MAPLE_ROOT
    env["PATH"] = os.path.join(MAPLE_ROOT, "bin.X86_64_WINDOWS") + \
        os.pathsep + env.get("PATH", "")

    proc = subprocess.Popen(
        [MAPLE_PATH, "-q"],
        stdin=subprocess.PIPE, stdout=subprocess.PIPE,
        stderr=subprocess.STDOUT, text=True,
        cwd=os.path.join(MAPLE_ROOT, "bin.X86_64_WINDOWS"),
        env=env,
        creationflags=subprocess.CREATE_NO_WINDOW)

    out, _ = proc.communicate(input=script, timeout=timeout)
    return out

def category_to_module(category):
    """Map a material category to its Maple module name."""
    return "NODE" + category.capitalize() + "Material"

# ---------------------------------------------------------------------------
# Main execution
# ---------------------------------------------------------------------------
category = str(category).strip().lower()
module_name = category_to_module(category)
grade = str(grade).strip()

# Normalise the incoming names: trim whitespace and any surrounding quotes.
prop_list = []
for p in (prop_names if prop_names else []):
    s = str(p).strip().strip('"').strip("'")
    if s:
        prop_list.append(s)

# Steel: split composite grade "S 275 H@NS-EN 10210-1" into grade + code.
if "@" in grade:
    g, code = grade.rsplit("@", 1)
    query_line = f'pval := {module_name}:-Property("{g}", "{code}", pname):'
else:
    g = grade
    query_line = f'pval := {module_name}:-Property("{g}", pname):'

# Pass the property list into Maple as a quoted list literal.
# Names contain commas ("f_m,k"), so every element MUST be quoted.
maple_list = "[" + ", ".join('"%s"' % p for p in prop_list) + "]"

# One record per property, fixed field layout:
#   REC|<name>|num|<value>|<unit>
#   REC|<name>|text|<string>
#   REC|<name>|skip|
# "|" is ASCII and proven to survive the pipe. Neither property names
# nor unit expressions contain it.
script = (
    f'kernelopts(printbytes=false):\n'
    f'interface(prettyprint=0):\n'
    f'props := {maple_list}:\n'
    f'for i from 1 to numelems(props) do\n'
    f'  pname := props[i]:\n'
    f'  {query_line}\n'
    f'  if type(pval, string) then\n'
    f'    printf("REC|%s|text|%s\\n", pname, pval):\n'
    f'  else\n'
    f'    try\n'
    f'      q := Units:-Split(pval):\n'
    f'      printf("REC|%s|num|%a|%a\\n", pname, evalf(q[1]), q[2]):\n'
    f'    catch:\n'
    f'      try\n'
    f'        printf("REC|%s|num|%a|\\n", pname, evalf(pval)):\n'
    f'      catch:\n'
    f'        printf("REC|%s|skip|\\n", pname):\n'
    f'      end try:\n'
    f'    end try:\n'
    f'  end if:\n'
    f'end do:\n'
    f'quit:\n'
)

raw = run_maple_script(script)

# ---------------------------------------------------------------------------
# Parse results — output order follows the requested prop_list
# ---------------------------------------------------------------------------
names_in = list(prop_list)
values = []
units = []
texts = []
table = []

recs = {}          # {name: (kind, payload, unit)}
for line in raw.splitlines():
    s = line.strip()
    if not s.startswith("REC|"):
        continue
    parts = s.split("|")
    if len(parts) < 3:
        continue
    name = parts[1].strip()
    kind = parts[2].strip()
    payload = parts[3].strip() if len(parts) > 3 else ""
    unit = parts[4].strip() if len(parts) > 4 else ""
    recs[name] = (kind, payload, unit)

for name in names_in:
    kind, payload, unit = recs.get(name, ("missing", "", ""))
    if kind == "num":
        try:
            val = float(payload)
        except ValueError:
            val = None
        values.append(val)
        units.append(unit)
        texts.append(None)
        table.append("%s = %s %s" % (name, val, unit))
    elif kind == "text":
        values.append(None)
        units.append("")
        texts.append(payload)
        table.append("%s = %s" % (name, payload))
    elif kind == "missing":
        values.append(None)
        units.append("")
        texts.append(None)
        table.append("%s = <no record returned>" % name)
    else:
        values.append(None)
        units.append("")
        texts.append(None)
        table.append("%s = <not evaluable>" % name)

debug = "sent %d names, parsed %d records\n" % (len(names_in), len(recs)) + raw
# ---------- end python_3_script ----------
panel_11 = Panel(python_3_script.table)
panel_12 = Panel(material_grade_picker.grade)
panel_13 = Panel(material_grade_picker.category)
panel_14 = Panel(python_3_script.values)
panel_15 = Panel(python_3_script.debug)
nodemaple_material_properties = Python3Script(category=material_grade_picker.category, grade=material_grade_picker.grade)  # -> values, texts, prop_names, prop_values, prop_units, debug; disabled
# ---------- nodemaple_material_properties: Python ----------
"""
NODEMaple Batch Property Values — Level 4 (Batch)
Fetches ALL property values for a SINGLE material grade in one Maple process.

Handles three value kinds:
  - numeric with unit -> values / prop_values / prop_units
  - plain string      -> texts    (e.g. concrete strengthclass_CEN = "C30/37")
  - not evaluable     -> skipped  (recorded instead of aborting the run)

For steel: accepts composite grade names "S 275 H@NS-EN 10210-1" and uses
the 3-argument Property(grade, code, par) call.

Input:
  category     : material category, e.g. "timber", "steel", "concrete"
  grade        : grade name, e.g. "C24" or "S 275 H@NS-EN 10210-1"
  maple_version: Maple year, e.g. "2026" (ignored if MAPLE env var is set)

Output:
  values      : dict, numeric properties -> (value, unit)
  texts       : dict, string properties  -> text
  prop_names  : ordered numeric property names
  prop_values : ordered numeric values (float)
  prop_units  : ordered unit strings
  skipped     : property names that could not be evaluated
  debug       : raw Maple output
"""
import os
import subprocess

# --- Configuration ---------------------------------------------------------
if os.environ.get("MAPLE"):
    MAPLE_ROOT = os.environ["MAPLE"]
else:
    MAPLE_ROOT = os.path.join(r"C:\Program Files", f"Maple {maple_version}")

MAPLE_PATH = os.path.join(MAPLE_ROOT, "bin.X86_64_WINDOWS", "cmaple.exe")


def run_maple_script(script, timeout=60):
    """Run a Maple script in a fresh cmaple process and return its output."""
    env = dict(os.environ)
    env["MAPLE"] = MAPLE_ROOT
    env["PATH"] = os.path.join(MAPLE_ROOT, "bin.X86_64_WINDOWS") + \
        os.pathsep + env.get("PATH", "")

    proc = subprocess.Popen(
        [MAPLE_PATH, "-q"],
        stdin=subprocess.PIPE, stdout=subprocess.PIPE,
        stderr=subprocess.STDOUT, text=True,
        cwd=os.path.join(MAPLE_ROOT, "bin.X86_64_WINDOWS"),
        env=env,
        creationflags=subprocess.CREATE_NO_WINDOW)

    out, _ = proc.communicate(input=script, timeout=timeout)
    return out


def category_to_module(category):
    """Map a material category to its Maple module name."""
    return "NODE" + category.capitalize() + "Material"


# --- Main ------------------------------------------------------------------
category = str(category).strip().lower()
module_name = category_to_module(category)
grade = str(grade).strip()

has_code = "@" in grade
if has_code:
    g, code = grade.rsplit("@", 1)
else:
    g, code = grade, None

# Only this line differs between steel (3-arg) and the others (2-arg).
if has_code:
    query_line = f'  pval := {module_name}:-Property("{g}", "{code}", pname):'
else:
    query_line = f'  pval := {module_name}:-Property("{g}", pname):'

# Every f-string uses SINGLE outer quotes, so Maple's double quotes are free.
# "\\n" is the one escape level needed for Maple's printf.
script = (
    f'kernelopts(printbytes=false):\n'
    f'interface(prettyprint=0):\n'
    f'props := {module_name}:-Property("metadata"):\n'
    f'n := numelems(props):\n'
    f'printf("COUNT|%d\\n", n):\n'
    f'for i from 1 to n do\n'
    f'  pname := props[i]:\n'
    f'{query_line}\n'
    f'  if type(pval, string) then\n'
    f'    printf("PROPSTR|%s|%s\\n", pname, pval):\n'
    f'  else\n'
    f'    try\n'
    f'      q := Units:-Split(pval):\n'
    f'      printf("PROPNAM|%s\\n", pname):\n'
    f'      printf("PROPVAL|%a\\n", evalf(q[1])):\n'
    f'      printf("PROPUNT|%a\\n", q[2]):\n'
    f'    catch:\n'
    f'      printf("PROPSKIP|%s\\n", pname):\n'
    f'    end try:\n'
    f'  end if:\n'
    f'end do:\n'
    f'quit:\n'
)

raw = run_maple_script(script)

# --- Parse -----------------------------------------------------------------
values = {}
texts = {}
skipped = []
prop_names = []
prop_values = []
prop_units = []

cur_name = None
cur_val = None

for line in raw.splitlines():
    s = line.strip()
    if s.startswith("PROPNAM|"):
        cur_name = s.split("|", 1)[1].strip()
    elif s.startswith("PROPVAL|") and cur_name is not None:
        try:
            cur_val = float(s.split("|", 1)[1])
        except ValueError:
            cur_val = None
    elif s.startswith("PROPUNT|") and cur_name is not None:
        unit = s.split("|", 1)[1].strip()
        prop_names.append(cur_name)
        prop_values.append(cur_val)
        prop_units.append(unit)
        values[cur_name] = (cur_val, unit)
        cur_name = None
        cur_val = None
    elif s.startswith("PROPSTR|"):
        parts = s.split("|", 2)
        if len(parts) == 3:
            texts[parts[1].strip()] = parts[2].strip()
    elif s.startswith("PROPSKIP|"):
        skipped.append(s.split("|", 1)[1].strip())

debug = raw
# ---------- end nodemaple_material_properties ----------

populate_valuelist_3 = Python3Script(list_name="VL_material", names=nodemaple_materialdefinitions.categories)  # -> out, a; inputs list_name: String, names: list of String, values: list of String; disabled; same code as populate_valuelist
populate_valuelist_4 = Python3Script(list_name="VL_grade", names=tree_branch_3)  # -> out, a; inputs list_name: String, names: list of String, values: list of String; disabled; same code as populate_valuelist
populate_valuelist_5 = Python3Script(
    list_name="VL_properties",
    names=nodemaple_material_properties.prop_names,
    values=nodemaple_material_properties.prop_names)  # -> out, a; inputs list_name: String, names: list of String, values: list of String; disabled; same code as populate_valuelist

merge = Merge(Data1=nodemaple_material_properties.values, Data2=nodemaple_material_properties.texts)
panel_16 = Panel(nodemaple_material_properties.values)
panel_17 = Panel(merge)
panel_18 = Panel(python_3_script.units)
python_3_script_2 = Python3Script(prop_names=nodemaple_material_properties.prop_names, texts=nodemaple_material_properties.texts)  # -> all_props, prop_types; inputs prop_names: list, texts: list
# ---------- python_3_script_2: Python ----------
"""
Unified Property Selector
Merges numeric and string property names from batch component outputs
into a single list suitable for a Value List dropdown.

Input:
  prop_names  : list of numeric property names (List Access!)
  texts       : dict of string properties (List Access!), e.g. {"strengthclass_CEN": "C30/37"}

Output:
  all_props   : merged list, e.g. ["strengthclass_CEN", "f_ck", "f_ck,cube"]
  prop_types  : parallel list indicating type, e.g. ["text", "num", "num"]
  debug       : diagnostic info
"""
# Defensive unwrapping: if texts came in as a list of one item (the dict), unwrap it
if isinstance(texts, list):
    if len(texts) == 1 and isinstance(texts[0], dict):
        texts_dict = texts[0]
    elif len(texts) == 1:
        # It's a string representation of a dict — try to eval it
        try:
            texts_dict = eval(str(texts[0]))
        except:
            texts_dict = {}
    else:
        texts_dict = {}
elif isinstance(texts, dict):
    texts_dict = texts
else:
    texts_dict = {}

all_props = []
prop_types = []

# Add string properties from texts dict
for key in sorted(texts_dict.keys()):
    all_props.append(key)
    prop_types.append("text")

# Add numeric properties
for name in prop_names:
    all_props.append(name)
    prop_types.append("num")

debug = f"Total properties: {len(all_props)}, strings: {len(texts_dict)}, numeric: {len(prop_names)}"
# ---------- end python_3_script_2 ----------
panel_19 = Panel(python_3_script.texts)
panel_20 = Panel(nodemaple_material_properties.prop_names)
panel_21 = Panel(nodemaple_material_properties.texts)
panel_22 = Panel(nodemaple_material_properties.prop_values)
panel_23 = Panel(python_3_script_2.all_props)
panel_24 = Panel(python_3_script_2.prop_types)
vl_properties = ValueList({"f_ck", "f_ck,cube"}, selected="f_ck")
panel_25 = Panel(nodemaple_material_properties.prop_units)
single_material_property = Python3Script(category=material_grade_picker.category, grade=material_grade_picker.grade, prop=vl_properties)  # -> value, unit, text, debug; disabled
# ---------- single_material_property: Python ----------
"""
NODEMaple Single Property — Level 4
Fetches ONE property for ONE grade, in a fresh Maple process.

Handles three value kinds:
  - numeric with unit -> value / unit
  - plain string      -> text   (e.g. concrete strengthclass_CEN = "C30/37")
  - not evaluable     -> all empty; debug shows FAILED

For steel: accepts composite grade names "S 275 H@NS-EN 10210-1".

Input:
  category     : "timber", "steel", "concrete"
  grade        : "C24" or "S 275 H@NS-EN 10210-1"
  prop         : property name from metadata, e.g. "f_m,k"
  maple_version: Maple year, e.g. "2026"

Output:
  value : float, or None for text properties
  unit  : unit string, or ""
  text  : string value for text properties (otherwise None)
  debug : raw Maple output
"""
import os
import subprocess

if os.environ.get("MAPLE"):
    MAPLE_ROOT = os.environ["MAPLE"]
else:
    MAPLE_ROOT = os.path.join(r"C:\Program Files", f"Maple {maple_version}")

MAPLE_PATH = os.path.join(MAPLE_ROOT, "bin.X86_64_WINDOWS", "cmaple.exe")


def run_maple_script(script, timeout=20):
    """Run a Maple script in a fresh cmaple process and return its output."""
    env = dict(os.environ)
    env["MAPLE"] = MAPLE_ROOT
    env["PATH"] = os.path.join(MAPLE_ROOT, "bin.X86_64_WINDOWS") + \
        os.pathsep + env.get("PATH", "")

    proc = subprocess.Popen(
        [MAPLE_PATH, "-q"],
        stdin=subprocess.PIPE, stdout=subprocess.PIPE,
        stderr=subprocess.STDOUT, text=True,
        cwd=os.path.join(MAPLE_ROOT, "bin.X86_64_WINDOWS"),
        env=env,
        creationflags=subprocess.CREATE_NO_WINDOW)

    out, _ = proc.communicate(input=script, timeout=timeout)
    return out


def category_to_module(category):
    """Map a material category to its Maple module name."""
    return "NODE" + category.capitalize() + "Material"


# --- Main ------------------------------------------------------------------
category = str(category).strip().lower()
module_name = category_to_module(category)
grade = str(grade).strip()
prop = str(prop).strip()

if "@" in grade:
    g, code = grade.rsplit("@", 1)
    query_line = f'p := {module_name}:-Property("{g}", "{code}", "{prop}"):'
else:
    query_line = f'p := {module_name}:-Property("{grade}", "{prop}"):'

script = (
    f'kernelopts(printbytes=false):\n'
    f'interface(prettyprint=0):\n'
    f'{query_line}\n'
    f'if type(p, string) then\n'
    f'  printf("TEXT=%s\\n", p):\n'
    f'else\n'
    f'  try\n'
    f'    q := Units:-Split(p):\n'
    f'    printf("VALUE=%a\\n", evalf(q[1])):\n'
    f'    printf("UNIT=%a\\n", q[2]):\n'
    f'  catch:\n'
    f'    printf("FAILED=1\\n"):\n'
    f'  end try:\n'
    f'end if:\n'
    f'quit:\n'
)

raw = run_maple_script(script)

value = None
unit = ""
text = None

for line in raw.splitlines():
    s = line.strip()
    if s.startswith("VALUE="):
        try:
            value = float(s.split("=", 1)[1])
        except ValueError:
            value = None
    elif s.startswith("UNIT="):
        unit = s.split("=", 1)[1]
    elif s.startswith("TEXT="):
        text = s.split("=", 1)[1]

debug = raw
# ---------- end single_material_property ----------
panel_26 = Panel(nodemaple_material_properties.debug)
panel_27 = Panel(single_material_property.debug)
panel_28 = Panel(single_material_property.value)
panel_29 = Panel(single_material_property.text)
panel_30 = Panel(single_material_property.unit)
