# Grasshopper definition NODEMaple Grasshopper.gh (Grasshopper 1.0.9)

nodemaple_steelprofiles = NODEMapleSteelProfiles()  # -> families, sections_tree, metadata_tree, debug; disabled
# ---------- nodemaple_steelprofiles: Python ----------
"""
NODEMaple Section Definitions
Discovers steel profile families and, per family, the section list and
the section property names — in a single Maple process.

Hierarchy (one level deeper than materials):
  NODESteelProfiles:-Property("allmembers")       -> families
  NODESteelProfiles_<family>:-Property(...)       -> sections, metadata

Module names are constructed dynamically (NODESteelProfiles_<family>),
so new families are picked up automatically — no static lookup table.

Input:
  maple_version : Maple year, e.g. "2026" (ignored if MAPLE env var is set)

Output:
  families      : ordered list of family names (branch keys)
  sections_tree : tree, branch per family -> section names
  metadata_tree : tree, branch per family -> section property names
  debug         : raw Maple output; SKIP|<family> lines report failures
"""
import os
import subprocess
import Grasshopper
from Grasshopper.Kernel.Data import GH_Path

# ---------------------------------------------------------------------------
# Configuration
# ---------------------------------------------------------------------------
if os.environ.get("MAPLE"):
    MAPLE_ROOT = os.environ["MAPLE"]
else:
    MAPLE_ROOT = os.path.join(r"C:\Program Files", f"Maple {maple_version}")

MAPLE_PATH = os.path.join(MAPLE_ROOT, "bin.X86_64_WINDOWS", "cmaple.exe")

def run_maple_script(script, timeout=60):
    """Run a Maple script in a fresh cmaple process and return its output."""
    env = dict(os.environ)
    env["MAPLE"] = MAPLE_ROOT
    env["PATH"] = os.path.join(MAPLE_ROOT, "bin.X86_64_WINDOWS") + \
        os.pathsep + env.get("PATH", "")

    proc = subprocess.Popen(
        [MAPLE_PATH, "-q"],
        stdin=subprocess.PIPE, stdout=subprocess.PIPE,
        stderr=subprocess.STDOUT, text=True,
        cwd=os.path.join(MAPLE_ROOT, "bin.X86_64_WINDOWS"),
        env=env,
        creationflags=subprocess.CREATE_NO_WINDOW)

    out, _ = proc.communicate(input=script, timeout=timeout)
    return out

def query_section_data():
    """Fetch families, sections and metadata in one Maple process.

    Emits: CAT|<family>            once per family, in order
           LIST|sec|<family>|<section name>
           LIST|meta|<family>|<property name>
           SKIP|<family>           if the family module cannot be resolved

    Module resolution is dynamic: parse(cat("NODESteelProfiles_", f)).
    If that fails to trigger the toolbox autoloader for a family,
    the try/catch reports it as SKIP instead of aborting the run.
    """
    script_lines = [
        "kernelopts(printbytes=false):",
        "interface(prettyprint=0):",
        'fams := NODESteelProfiles:-Property("allmembers"):',
        "for f in fams do",
        '  printf("CAT|%s\\n", f):',
        "  try",
        '    M := parse(cat("NODESteelProfiles_", f)):',
        '    for e in M:-Property("allmembers") do',
        '      printf("LIST|sec|%s|%s\\n", f, e):',
        "    end do:",
        '    for e in M:-Property("metadata") do',
        '      printf("LIST|meta|%s|%s\\n", f, e):',
        "    end do:",
        "  catch:",
        '    printf("SKIP|%s\\n", f):',
        "  end try:",
        "end do:",
        "quit:",
    ]
    return run_maple_script("\n".join(script_lines) + "\n")

# ---------------------------------------------------------------------------
# Main execution
# ---------------------------------------------------------------------------
raw = query_section_data()

families = []                 # ordered family names (= branch keys)
sections_by_fam = {}          # {"I": ["IPE 200", ...]}
metadata_by_fam = {}          # {"I": ["A_x", ...]}

for line in raw.splitlines():
    s = line.strip()
    if s.startswith("CAT|"):
        fam = s.split("|", 1)[1].strip()
        if fam:
            families.append(fam)
            sections_by_fam.setdefault(fam, [])
            metadata_by_fam.setdefault(fam, [])
    elif s.startswith("LIST|sec|") or s.startswith("LIST|meta|"):
        parts = s.split("|", 3)
        if len(parts) == 4:
            _, kind, fam, entry = parts
            entry = entry.strip().strip('"')
            if not entry:
                continue
            if kind == "sec":
                sections_by_fam.setdefault(fam, []).append(entry)
            else:
                metadata_by_fam.setdefault(fam, []).append(entry)

# Build the trees — branch index i corresponds to families[i]
sections_tree = Grasshopper.DataTree[object]()
metadata_tree = Grasshopper.DataTree[object]()

for i, fam in enumerate(families):
    path = GH_Path(i)
    sections_tree.AddRange(sections_by_fam.get(fam, []), path)
    metadata_tree.AddRange(metadata_by_fam.get(fam, []), path)

debug = raw
# ---------- end nodemaple_steelprofiles ----------
nodemaple_timber_fastener_definitions = Python3Script()  # -> types, members_tree, metadata_tree, producers_tree, diameters_tree, debug
# ---------- nodemaple_timber_fastener_definitions: Python ----------
# SPDX-License-Identifier: GPL-3.0-or-later
#
# Copyright (C) 2026 Andreas Zieritz
#
# This program is free software: you can redistribute it and/or modify
# it under the terms of the GNU General Public License as published by
# the Free Software Foundation, either version 3 of the License, or
# (at your option) any later version.
#
# This program is distributed in the hope that it will be useful,
# but WITHOUT ANY WARRANTY; without even the implied warranty of
# MERCHANTABILITY or FITNESS FOR A PARTICULAR PURPOSE.  See the
# GNU General Public License for more details: https://www.gnu.org/licenses/gpl-3.0.txt

"""
NODEMaple Timber Fastener Definitions

Discovers timber fastener types (Nail, Screw, Bolt, Dowel, ...) and, per
type, the member list, the variable names, the producers and the
diameters — in a single Maple process. Mirrors
NODEMaple_MaterialDefinitions.py, but with two additional trees.

Hierarchy (one Property call per output tree):
  NODETimberFasteners:-Property("allmembers")     -> types
  NODETimberFasteners:-Property(t, "allmembers")  -> members "producer@product"
  NODETimberFasteners:-Property(t, "metadata")    -> variable names
  NODETimberFasteners:-Property(t, "producers")   -> producer names
  NODETimberFasteners:-Property(t, "diameters")  -> unit-free diameters (6, 6.2, ...)

Diameter handling (robust against Maple number formats):
  - Maple emits evalf(e), forcing decimal form (avoids rationals like 31/5)
  - Python accepts plain floats, and falls back to:
      * fraction parsing "a/b" -> a/b
      * keeping the raw string in the tree (nothing is dropped silently)
  - the debug summary lists rejected raw values, if any, so the
    actual Maple output format is always visible

Input:
  maple_version : Maple year, e.g. "2026" (ignored if MAPLE env var is set)

Output:
  types         : ordered list of fastener types (branch keys)
  members_tree  : tree, branch per type -> "producer@product" designations
  metadata_tree : tree, branch per type -> variable names
  producers_tree: tree, branch per type -> producer names
  diameters_tree: tree, branch per type -> diameters (numbers when parseable)
  debug         : raw Maple output with a count/reject summary header
"""

import os
import subprocess
import Grasshopper
from Grasshopper.Kernel.Data import GH_Path

# ---------------------------------------------------------------------------
# Configuration
# ---------------------------------------------------------------------------
if os.environ.get("MAPLE"):
    MAPLE_ROOT = os.environ["MAPLE"]
else:
    MAPLE_ROOT = os.path.join(r"C:\Program Files", f"Maple {maple_version}")

MAPLE_PATH = os.path.join(MAPLE_ROOT, "bin.X86_64_WINDOWS", "cmaple.exe")

def run_maple_script(script, timeout=60):
    """Run a Maple script in a fresh cmaple process and return its output."""
    env = dict(os.environ)
    env["MAPLE"] = MAPLE_ROOT
    env["PATH"] = os.path.join(MAPLE_ROOT, "bin.X86_64_WINDOWS") + \
        os.pathsep + env.get("PATH", "")

    proc = subprocess.Popen(
        [MAPLE_PATH, "-q"],
        stdin=subprocess.PIPE, stdout=subprocess.PIPE,
        stderr=subprocess.STDOUT, text=True,
        cwd=os.path.join(MAPLE_ROOT, "bin.X86_64_WINDOWS"),
        env=env,
        creationflags=subprocess.CREATE_NO_WINDOW)

    out, _ = proc.communicate(input=script, timeout=timeout)
    return out

def query_fastener_data():
    """Fetch types, members, metadata, producers and diameters in one
    Maple process.

    Emits: CAT|<type>               once per fastener type, in order
           LIST|mem|<type>|producer@product
           LIST|meta|<type>|<variable name>
           LIST|prod|<type>|<producer>
           LIST|dia|<type>|<diameter, evalf-decimal>
           SKIP|<type>              if the type cannot be queried

    NOTE: every Maple statement is terminated with ":" or ";".
    Omitting a terminator lets the parser swallow the following line,
    producing misleading syntax errors.
    """
    script_lines = [
        "kernelopts(printbytes=false):",
        "interface(prettyprint=0):",
        'types := NODETimberFasteners:-Property("allmembers"):',
        "for t in types do",
        '  printf("CAT|%s\\n", t):',
        "  try",
        "# Product designations of this fastener type (producer@product)",
        '    for e in NODETimberFasteners:-Property(t, "allmembers") do',
        '      printf("LIST|mem|%s|%s\\n", t, e):',
        "    end do:",
        "# Variable names (shared metadata table for all types)",
        '    for e in NODETimberFasteners:-Property(t, "metadata") do',
        '      printf("LIST|meta|%s|%s\\n", t, e):',
        "    end do:",
        "# Producers offering at least one product of this type",
        '    for e in NODETimberFasteners:-Property(t, "producers") do',
        '      printf("LIST|prod|%s|%s\\n", t, e):',
        "    end do:",
        "# Diameters: evalf forces decimal form (no rationals such as 31/5)",
        '    for e in NODETimberFasteners:-Property(t, "diameters") do',
        '      printf("LIST|dia|%s|%a\\n", t, evalf(e)):',
        "    end do:",
        "  catch:",
        '    printf("SKIP|%s\\n", t):',
        "  end try:",
        "end do:",
        "quit:",
    ]
    return run_maple_script("\n".join(script_lines) + "\n")

# ---------------------------------------------------------------------------
# Main execution
# ---------------------------------------------------------------------------
raw = query_fastener_data()

types = []                    # ordered fastener types (= branch keys)
members_by_type = {}          # {"Screw": ["Rotblau@ASSY 4 CSMP", ...]}
metadata_by_type = {}         # {"Screw": ["fm", "prod", ...]}
producers_by_type = {}        # {"Screw": ["Rotblau", "Wuerth", ...]}
diameters_by_type = {}        # {"Screw": [3.0, 3.5, 4.0, ...]}
dia_rejects = []              # values that were not plain-parseable

def parse_diameter(text):
    """Best-effort numeric parse of a Maple-emitted diameter.

    Returns (value, ok). Handles plain floats ("24.0", "24."), Maple
    fractions ("31/5") and falls back to the raw string otherwise —
    nothing is dropped silently.
    """
    t = text.strip()
    try:
        return float(t), True
    except ValueError:
        pass
    if "/" in t:
        try:
            a, b = t.split("/", 1)
            return float(a.strip()) / float(b.strip()), True
        except ValueError:
            pass
    return t, False

for line in raw.splitlines():
    s = line.strip()
    if s.startswith("CAT|"):
        typ = s.split("|", 1)[1].strip()
        if typ:
            types.append(typ)
            members_by_type.setdefault(typ, [])
            metadata_by_type.setdefault(typ, [])
            producers_by_type.setdefault(typ, [])
            diameters_by_type.setdefault(typ, [])
    elif s.startswith("LIST|"):
        parts = s.split("|", 3)
        if len(parts) == 4:
            _, kind, typ, entry = parts
            typ = typ.strip()
            entry = entry.strip().strip('"')
            if not entry:
                continue
            if kind == "mem":
                members_by_type.setdefault(typ, []).append(entry)
            elif kind == "meta":
                metadata_by_type.setdefault(typ, []).append(entry)
            elif kind == "prod":
                producers_by_type.setdefault(typ, []).append(entry)
            elif kind == "dia":
                val, ok = parse_diameter(entry)
                diameters_by_type.setdefault(typ, []).append(val)
                if not ok:
                    # Keep the value, but record it so the debug output
                    # reveals the exact format Maple produced.
                    dia_rejects.append((typ, entry))

# Build the trees — branch index i corresponds to types[i]
members_tree = Grasshopper.DataTree[object]()
metadata_tree = Grasshopper.DataTree[object]()
producers_tree = Grasshopper.DataTree[object]()
diameters_tree = Grasshopper.DataTree[object]()

for i, typ in enumerate(types):
    path = GH_Path(i)
    members_tree.AddRange(members_by_type.get(typ, []), path)
    metadata_tree.AddRange(metadata_by_type.get(typ, []), path)
    producers_tree.AddRange(producers_by_type.get(typ, []), path)
    diameters_tree.AddRange(diameters_by_type.get(typ, []), path)

counts = ("parsed per kind: mem=%d meta=%d prod=%d dia=%d (%d unparseable, "
          "kept as raw text)" % (
              sum(len(v) for v in members_by_type.values()),
              sum(len(v) for v in metadata_by_type.values()),
              sum(len(v) for v in producers_by_type.values()),
              sum(len(v) for v in diameters_by_type.values()),
              len(dia_rejects)))
if dia_rejects:
    counts += "\nunparseable diameters: " + \
        "; ".join("[%s] %r" % (t, v) for t, v in dia_rejects[:20])
debug = counts + "\n" + raw
# ---------- end nodemaple_timber_fastener_definitions ----------
nodemaple_materialdefinitions = NODEMapleMaterialDefinitions()  # -> categories, members_tree, metadata_tree, debug; disabled
# ---------- nodemaple_materialdefinitions: Python ----------
"""
NODEMaple Material Data — Levels 2 & 3 (tree output)
Queries grade lists ("allmembers") and property definitions ("metadata")
for all material categories in a single Maple process, and returns them
as Grasshopper data trees whose branches correspond to categories.

For steel: grades include standard code (e.g. "S 275 H@NS-EN 10210-1")
to disambiguate grades that appear under multiple standards.

The branch order matches the order reported by NODEFunctions:-Materials(),
so a branch index is valid simultaneously in both trees.

Input:
  maple_version : Maple year, e.g. "2026" (ignored if MAPLE env var is set)

Output:
  members_tree  : tree, branch per category -> list of grade names
  metadata_tree : tree, branch per category -> list of property names
  categories    : ordered list of category names (branch keys, human-readable)
  debug         : raw Maple output; also shows SKIP|<category> lines
"""
import os
import subprocess
import Grasshopper
from Grasshopper.Kernel.Data import GH_Path

# ---------------------------------------------------------------------------
# Configuration
# ---------------------------------------------------------------------------
if os.environ.get("MAPLE"):
    MAPLE_ROOT = os.environ["MAPLE"]
else:
    MAPLE_ROOT = os.path.join(r"C:\Program Files", f"Maple {maple_version}")

MAPLE_PATH = os.path.join(MAPLE_ROOT, "bin.X86_64_WINDOWS", "cmaple.exe")

def run_maple_script(script, timeout=30):
    """Run a Maple script in a fresh cmaple process and return its output."""
    env = dict(os.environ)
    env["MAPLE"] = MAPLE_ROOT
    env["PATH"] = os.path.join(MAPLE_ROOT, "bin.X86_64_WINDOWS") + \
        os.pathsep + env.get("PATH", "")

    proc = subprocess.Popen(
        [MAPLE_PATH, "-q"],
        stdin=subprocess.PIPE, stdout=subprocess.PIPE,
        stderr=subprocess.STDOUT, text=True,
        cwd=os.path.join(MAPLE_ROOT, "bin.X86_64_WINDOWS"),
        env=env,
        creationflags=subprocess.CREATE_NO_WINDOW)

    out, _ = proc.communicate(input=script, timeout=timeout)
    return out

def query_material_data():
    """Fetch categories, grades and metadata in one Maple process.

    For STEEL: outputs CODE@GRADE combinations to disambiguate
    grades appearing under multiple standards (e.g. "S 275 H@NS-EN 10210-1").
    
    Emits: CAT|<category>          once per category, in order
           LIST|mem|<category>|<grade>
           LIST|meta|<category>|<property>
           SKIP|<category>         for unmapped categories

    NOTE: every Maple statement is terminated with ":" or ";".
    Omitting a terminator lets the parser swallow the following line
    (e.g. an inline if-expression), producing misleading syntax errors.
    """
    script_lines = [
        "kernelopts(printbytes=false):",
        "interface(prettyprint=0):",
        '# Category -> module mapping',
        'nodetab := table(["steel"    = NODESteelMaterial,',
        '                  "timber"   = NODETimberMaterial,',
        '                  "concrete" = NODEConcreteMaterial]):',
        '# Categories are discovered at runtime',
        "cats := NODEFunctions:-Materials():",
        "known := [indices(nodetab, 'nolist')]:",
        "for c in cats do",
        '  printf("CAT|%s\\n", c):',
        "  if member(c, known) then",
        "    M := nodetab[c]:",
        '# Steel: special handling for code-grade pairs',
        '  if c = "steel" then',
        '# First get all codes',
        '    codes := M:-Property("allcodes"):',
        '    for code in codes do',
        '# Then grades of this code',
        '      for g in M:-Property(code,"allmembers") do',
        '# Composite grade name: grade@code',
        '        fullname := cat(g,"@",code):',
        '        printf("LIST|mem|%s|%s\\n", c, fullname):',
        "      end do:",
        "    end do:",
        "  else:",
        '# Non-steel: simple grade list',
        '    for e in M:-Property("allmembers") do',
        '      printf("LIST|mem|%s|%s\\n", c, e):',
        "    end do:",
        "  end if:",
        '# Metadata is always simple list',
        '    for e in M:-Property("metadata") do',
        '      printf("LIST|meta|%s|%s\\n", c, e):',
        "    end do:",
        "  else",
        '    printf("SKIP|%s\\n", c):',
        "  end if:",
        "end do:",
        "quit:",
    ]
    return run_maple_script("\n".join(script_lines) + "\n")

# ---------------------------------------------------------------------------
# Main execution
# ---------------------------------------------------------------------------
raw = query_material_data()

categories = []                 # ordered category names (= branch keys)
members_by_cat = {}             # {"timber": [grades...]}
metadata_by_cat = {}            # {"timber": [properties...]}

for line in raw.splitlines():
    s = line.strip()
    if s.startswith("CAT|"):
        cat = s.split("|", 1)[1].strip()
        if cat:
            categories.append(cat)
            members_by_cat.setdefault(cat, [])
            metadata_by_cat.setdefault(cat, [])
    elif s.startswith("LIST|mem|"):
        parts = s.split("|", 3)
        if len(parts) == 4:
            _, kind, cat, entry = parts
            entry = entry.strip().strip('"')
            if entry:
                members_by_cat.setdefault(cat, []).append(entry)
    elif s.startswith("LIST|meta|"):
        parts = s.split("|", 3)
        if len(parts) == 4:
            _, kind, cat, entry = parts
            entry = entry.strip().strip('"')
            if entry:
                metadata_by_cat.setdefault(cat, []).append(entry)

# Build the trees — GH1 recipe
members_tree = Grasshopper.DataTree[object]()
metadata_tree = Grasshopper.DataTree[object]()

for i, cat in enumerate(categories):
    path = GH_Path(i)
    members_tree.AddRange(members_by_cat.get(cat, []), path)
    metadata_tree.AddRange(metadata_by_cat.get(cat, []), path)

debug = raw
# ---------- end nodemaple_materialdefinitions ----------
panel = Panel(nodemaple_timber_fastener_definitions.debug)
vl_material = ValueList({"steel": 0, "timber": 1, "concrete": 2}, selected="timber")
panel_2 = Panel(nodemaple_steelprofiles.families)
panel_3 = Panel(nodemaple_timber_fastener_definitions.metadata_tree)
panel_4 = Panel(nodemaple_timber_fastener_definitions.types)
panel_5 = Panel(nodemaple_timber_fastener_definitions.diameters_tree)
panel_6 = Panel(nodemaple_steelprofiles.sections_tree)
tree_branch = TreeBranch(Tree=nodemaple_materialdefinitions.members_tree, Path=vl_material, MaintainPaths=True)
tree_branch_2 = TreeBranch(Tree=nodemaple_materialdefinitions.metadata_tree, Path=vl_material, MaintainPaths=True)
populate_valuelist = PopulateValueList(list_name="VL_fastenertype", names=nodemaple_timber_fastener_definitions.types)  # -> out, a; inputs list_name: String, names: list of String, values: list of String
#   port list_name: name of value list component to be modified
#   port names: list with values
#   port values: export values for chosen items, if empty, index values are returned
# ---------- populate_valuelist: Python ----------
import Grasshopper as gh
from Grasshopper.Kernel.Special import GH_ValueListItem

doc = ghenv.Component.OnPingDocument()

# list_name og names må alltid være definert
if doc and list_name and names:
    
    # 1. Finn Value List på lerretet basert på Nickname
    target_list = None
    for obj in doc.Objects:
        if isinstance(obj, gh.Kernel.Special.GH_ValueList) and obj.NickName == list_name:
            target_list = obj
            break

    if target_list:
        formatted_items = []
        has_custom_values = bool(values and len(values) > 0)

        for i, name in enumerate(names):
            n = str(name).strip()
            
            if has_custom_values and i < len(values):
                # Bruk oppgitt verdi fra 'values'
                val_raw = str(values[i]).strip()
                try:
                    float(val_raw)
                    expr = val_raw
                except ValueError:
                    expr = '"{}"'.format(val_raw)
            else:
                # Fallback: Bruk listenummer / indeks som heltall
                expr = str(i)

            formatted_items.append((n, expr))

        # Kontroller gjeldende tilstand for å unngå unødvendig oppdatering
        current_state = [(item.Name, item.Expression) for item in target_list.ListItems]
        
        if current_state != formatted_items:
            def update_callback(d):
                target_list.ListItems.Clear()
                for n, expr in formatted_items:
                    target_list.ListItems.Add(GH_ValueListItem(n, expr))
                
                target_list.Attributes.ExpireLayout()
                target_list.ExpireSolution(False)

            doc.ScheduleSolution(1, gh.Kernel.GH_Document.GH_ScheduleDelegate(update_callback))
# ---------- end populate_valuelist ----------
panel_7 = Panel(nodemaple_timber_fastener_definitions.members_tree)
panel_8 = Panel(tree_branch)
list_item = ListItem(List=nodemaple_materialdefinitions.categories, Index=vl_material, Wrap=True)
panel_9 = Panel(tree_branch_2)
vl_profiletype = ValueList({"CF_RHS": 0, "CF_SHS": 1, "H": 2, "HF_RHS": 3, "HF_SHS": 4, "I": 5}, selected="CF_RHS")
panel_10 = Panel(list_item)
tree_branch_3 = TreeBranch(Tree=panel_6, Path=vl_profiletype, MaintainPaths=True)

# ---- group: Value List Definition Steel Profiles
populate_valuelist_2 = PopulateValueList(list_name="VL_profiletype", names=nodemaple_steelprofiles.families)  # -> out, a; inputs list_name: String, names: list of String, values: list of String; same code as populate_valuelist
populate_valuelist_3 = PopulateValueList(list_name="VL_profile", names=tree_branch_3, values=tree_branch_3)  # -> out, a; inputs list_name: String, names: list of String, values: list of String; same code as populate_valuelist

# ----
vl_grade = ValueList({"C14", "C16", "C18", "C20", "C22", "C24", "C27", "C30", "C35", "C40"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}, selected="C14")
panel_11 = Panel(nodemaple_timber_fastener_definitions.producers_tree)
vl_profile = ValueList({"RHS 40 x 20 x 2", "RHS 40 x 20 x 2.5", "RHS 40 x 20 x 3", "RHS 50 x 30 x 2", "RHS 50 x 30 x 2.5", "RHS 50 x 30 x 3", "RHS 50 x 30 x 4", "RHS 60 x 40 x 2", "RHS 60 x 40 x 2.5", "RHS 60 x 40 x 3"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}, selected="RHS 40 x 20 x 2")
list_item_2 = ListItem(List=nodemaple_steelprofiles.families, Index=vl_profiletype, Wrap=True)  # -> simplify(Item)
tree_branch_4 = TreeBranch(Tree=nodemaple_steelprofiles.metadata_tree, Path=vl_profiletype, MaintainPaths=True)
nodemaple_materialproperties = NODEMapleMaterialProperties(category=panel_10, grade=vl_grade, prop_names=panel_9)  # -> values, units, texts, table, debug; inputs prop_names: list
# ---------- nodemaple_materialproperties: Python ----------
"""
NODEMaple Retrieve All Properties
Fetches ALL property values for a SINGLE material grade in one Maple process.

Workflow:
  material -> grade -> variables -> values

Accepts the variable list from the metadata branch (or any list of
property names). Returns parallel lists, so values[i] / units[i] /
texts[i] all belong to names_in[i].

Steel: use the composite grade "S 275 H@NS-EN 10210-1" to select the
standard; the "@code" suffix is split off and passed as the 3rd
Property argument.

Input:
  category      : "steel", "timber", "concrete"
  grade         : e.g. "C24", "S 275 H@NS-EN 10210-1"
  prop_names    : list of property names to fetch (List Access!)
  maple_version : Maple year, e.g. "2026" (ignored if MAPLE env var is set)

Output:
  names_in : echo of the requested property names (ordered)
  values   : parallel list of numeric values (None for text properties)
  units    : parallel list of unit strings ("" where none)
  texts    : parallel list of text values (None for numeric properties)
  table    : display list, "name = value unit" one line per property
  debug    : raw Maple output, preceded by a send/receive summary

NOTE: the Maple<->Python protocol is ASCII-only ("|" as field separator).
Non-ASCII separators do not survive the cmaple stdin/stdout round trip.
"""
import os
import subprocess

# ---------------------------------------------------------------------------
# Configuration
# ---------------------------------------------------------------------------
if os.environ.get("MAPLE"):
    MAPLE_ROOT = os.environ["MAPLE"]
else:
    MAPLE_ROOT = os.path.join(r"C:\Program Files", f"Maple {maple_version}")

MAPLE_PATH = os.path.join(MAPLE_ROOT, "bin.X86_64_WINDOWS", "cmaple.exe")

def run_maple_script(script, timeout=60):
    """Run a Maple script in a fresh cmaple process and return its output."""
    env = dict(os.environ)
    env["MAPLE"] = MAPLE_ROOT
    env["PATH"] = os.path.join(MAPLE_ROOT, "bin.X86_64_WINDOWS") + \
        os.pathsep + env.get("PATH", "")

    proc = subprocess.Popen(
        [MAPLE_PATH, "-q"],
        stdin=subprocess.PIPE, stdout=subprocess.PIPE,
        stderr=subprocess.STDOUT, text=True,
        cwd=os.path.join(MAPLE_ROOT, "bin.X86_64_WINDOWS"),
        env=env,
        creationflags=subprocess.CREATE_NO_WINDOW)

    out, _ = proc.communicate(input=script, timeout=timeout)
    return out

def category_to_module(category):
    """Map a material category to its Maple module name."""
    return "NODE" + category.capitalize() + "Material"

# ---------------------------------------------------------------------------
# Main execution
# ---------------------------------------------------------------------------
category = str(category).strip().lower()
module_name = category_to_module(category)
grade = str(grade).strip()

# Normalise the incoming names: trim whitespace and any surrounding quotes.
prop_list = []
for p in (prop_names if prop_names else []):
    s = str(p).strip().strip('"').strip("'")
    if s:
        prop_list.append(s)

# Steel: split composite grade "S 275 H@NS-EN 10210-1" into grade + code.
if "@" in grade:
    g, code = grade.rsplit("@", 1)
    query_line = f'pval := {module_name}:-Property("{g}", "{code}", pname):'
else:
    g = grade
    query_line = f'pval := {module_name}:-Property("{g}", pname):'

# Pass the property list into Maple as a quoted list literal.
# Names contain commas ("f_m,k"), so every element MUST be quoted.
maple_list = "[" + ", ".join('"%s"' % p for p in prop_list) + "]"

# One record per property, fixed field layout:
#   REC|<name>|num|<value>|<unit>
#   REC|<name>|text|<string>
#   REC|<name>|skip|
# "|" is ASCII and proven to survive the pipe. Neither property names
# nor unit expressions contain it.
script = (
    f'kernelopts(printbytes=false):\n'
    f'interface(prettyprint=0):\n'
    f'props := {maple_list}:\n'
    f'for i from 1 to numelems(props) do\n'
    f'  pname := props[i]:\n'
    f'  {query_line}\n'
    f'  if type(pval, string) then\n'
    f'    printf("REC|%s|text|%s\\n", pname, pval):\n'
    f'  else\n'
    f'    try\n'
    f'      q := Units:-Split(pval):\n'
    f'      printf("REC|%s|num|%a|%a\\n", pname, evalf(q[1]), q[2]):\n'
    f'    catch:\n'
    f'      try\n'
    f'        printf("REC|%s|num|%a|\\n", pname, evalf(pval)):\n'
    f'      catch:\n'
    f'        printf("REC|%s|skip|\\n", pname):\n'
    f'      end try:\n'
    f'    end try:\n'
    f'  end if:\n'
    f'end do:\n'
    f'quit:\n'
)

raw = run_maple_script(script)

# ---------------------------------------------------------------------------
# Parse results — output order follows the requested prop_list
# ---------------------------------------------------------------------------
names_in = list(prop_list)
values = []
units = []
texts = []
table = []

recs = {}          # {name: (kind, payload, unit)}
for line in raw.splitlines():
    s = line.strip()
    if not s.startswith("REC|"):
        continue
    parts = s.split("|")
    if len(parts) < 3:
        continue
    name = parts[1].strip()
    kind = parts[2].strip()
    payload = parts[3].strip() if len(parts) > 3 else ""
    unit = parts[4].strip() if len(parts) > 4 else ""
    recs[name] = (kind, payload, unit)

for name in names_in:
    kind, payload, unit = recs.get(name, ("missing", "", ""))
    if kind == "num":
        try:
            val = float(payload)
        except ValueError:
            val = None
        values.append(val)
        units.append(unit)
        texts.append(None)
        table.append("%s = %s %s" % (name, val, unit))
    elif kind == "text":
        values.append(None)
        units.append("")
        texts.append(payload)
        table.append("%s = %s" % (name, payload))
    elif kind == "missing":
        values.append(None)
        units.append("")
        texts.append(None)
        table.append("%s = <no record returned>" % name)
    else:
        values.append(None)
        units.append("")
        texts.append(None)
        table.append("%s = <not evaluable>" % name)

debug = "sent %d names, parsed %d records\n" % (len(names_in), len(recs)) + raw
# ---------- end nodemaple_materialproperties ----------
panel_12 = Panel(list_item_2)
panel_13 = Panel(panel_9)
panel_14 = Panel(tree_branch_4)
panel_15 = Panel(vl_profile)
vl_member = ValueList({"ISO 4014@ISO 4014 / DIN 931", "ROTHOBLAAS@EKS", "ROTHOBLAAS@KOS", "ROTHOBLAAS@KOSA2", "ROTHOBLAAS@KOT", "ROTHOBLAAS@KOTA2", "ROTHOBLAAS@MGS 4.8", "ROTHOBLAAS@MGS 8.8"}, selected="ISO 4014@ISO 4014 / DIN 931")
vl_producers = ValueList({"ISO 4014", "ROTHOBLAAS"}, selected="ROTHOBLAAS")
vl_diameter = ValueList({"6", "8", "10", "12", "14", "16", "18", "20", "22", "24", "27", "30", "33", "36", "39"}, selected="24")
vl_fastenertype = ValueList({"Bolt": 0, "Dowel": 1, "Nail": 2, "Screw": 3}, selected="Bolt")
tree_branch_5 = TreeBranch(Tree=nodemaple_timber_fastener_definitions.diameters_tree, Path=vl_fastenertype, MaintainPaths=True)
panel_16 = Panel(tree_branch_5)
populate_valuelist_4 = PopulateValueList(list_name="VL_diameter", names=tree_branch_5, values=tree_branch_5)  # -> out, a; inputs list_name: String, names: list of String, values: list of String; same code as populate_valuelist
tree_branch_6 = TreeBranch(Tree=panel_11, Path=vl_fastenertype, MaintainPaths=True)
populate_valuelist_5 = PopulateValueList(list_name="VL_producers", names=tree_branch_6, values=tree_branch_6)  # -> out, a; inputs list_name: String, names: list of String, values: list of String; same code as populate_valuelist
panel_17 = Panel(nodemaple_materialproperties.values)
text_split = TextSplit(Text=nodemaple_materialproperties.table, Separators="=")  # -> simplify(Result)
list_item_3 = ListItem(List=panel_4, Index=vl_fastenertype, Wrap=True)
tree_branch_7 = TreeBranch(Tree=panel_7, Path=vl_fastenertype, MaintainPaths=True)
nodemaple_steelprofileproperties = NODEMapleSteelProfileProperties(family=panel_12, section=panel_15, prop_names=panel_14)  # -> names_in, values, units, texts, table, debug; inputs prop_names: list
# ---------- nodemaple_steelprofileproperties: Python ----------
"""
NODEMaple Retrieve Section Properties
Fetches ALL section properties for a SINGLE section in one Maple process.

Mirrors NODEMaple Retrieve All Properties (materials), but targets
NODESteelProfiles_<family> modules.

Input:
  family        : family name, e.g. "I", "CF_RHS" (from families output)
  section       : section name, e.g. "IPE 200", "RHS 40 x 20 x 2"
  prop_names    : list of section property names (List Access!)
  maple_version : Maple year, e.g. "2026" (ignored if MAPLE env var is set)

Output:
  names_in : echo of the requested property names (ordered)
  values   : parallel list of numeric values (None for text properties)
  units    : parallel list of unit strings ("" where none)
  texts    : parallel list of text values (None for numeric properties)
  table    : display list, "name = value unit" one line per property
  debug    : raw Maple output, preceded by a send/receive summary
"""
import os
import subprocess

# ---------------------------------------------------------------------------
# Configuration
# ---------------------------------------------------------------------------
if os.environ.get("MAPLE"):
    MAPLE_ROOT = os.environ["MAPLE"]
else:
    MAPLE_ROOT = os.path.join(r"C:\Program Files", f"Maple {maple_version}")

MAPLE_PATH = os.path.join(MAPLE_ROOT, "bin.X86_64_WINDOWS", "cmaple.exe")

def run_maple_script(script, timeout=60):
    """Run a Maple script in a fresh cmaple process and return its output."""
    env = dict(os.environ)
    env["MAPLE"] = MAPLE_ROOT
    env["PATH"] = os.path.join(MAPLE_ROOT, "bin.X86_64_WINDOWS") + \
        os.pathsep + env.get("PATH", "")

    proc = subprocess.Popen(
        [MAPLE_PATH, "-q"],
        stdin=subprocess.PIPE, stdout=subprocess.PIPE,
        stderr=subprocess.STDOUT, text=True,
        cwd=os.path.join(MAPLE_ROOT, "bin.X86_64_WINDOWS"),
        env=env,
        creationflags=subprocess.CREATE_NO_WINDOW)

    try:
        out, _ = proc.communicate(input=script, timeout=timeout)
        return out
    except subprocess.TimeoutExpired:
        proc.kill()
        proc.communicate()
        raise RuntimeError("Maple timed out after %s s" % timeout)

# ---------------------------------------------------------------------------
# Main execution
# ---------------------------------------------------------------------------
family = str(family).strip()
module_name = "NODESteelProfiles_" + family
section = str(section).strip()

# Normalize the incoming names: trim whitespace and any surrounding quotes.
prop_list = []
for p in (prop_names if prop_names else []):
    s = str(p).strip().strip('"').strip("'")
    if s:
        prop_list.append(s)

# Build the Maple query line
query_line = f'pval := {module_name}:-Property("{section}", pname):'

# Quoted list literal — names contain commas (e.g. "W_el,y").
maple_list = "[" + ", ".join('"%s"' % p for p in prop_list) + "]"

# Protocol: ASCII "|" separator only, with try/catch for non-servable names.
script = (
    f'kernelopts(printbytes=false):\n'
    f'interface(prettyprint=0):\n'
    f'M := {module_name}:\n'
    f'sect := "{section}":\n'
    f'props := {maple_list}:\n'
    f'for i from 1 to numelems(props) do\n'
    f'  pname := props[i]:\n'
    f'  try\n'
    f'    pval := M:-Property(sect, pname):\n'
    f'  catch:\n'
    f'    printf("REC|%s|skip|\\n", pname):\n'
    f'    next;\n'
    f'  end try:\n'
    f'  if type(pval, string) then\n'
    f'    printf("REC|%s|text|%s\\n", pname, pval):\n'
    f'  else\n'
    f'    try\n'
    f'      q := Units:-Split(pval):\n'
    f'      printf("REC|%s|num|%a|%a\\n", pname, evalf(q[1]), q[2]):\n'
    f'    catch:\n'
    f'      try\n'
    f'        printf("REC|%s|num|%a|\\n", pname, evalf(pval)):\n'
    f'      catch:\n'
    f'        printf("REC|%s|skip|\\n", pname):\n'
    f'      end try:\n'
    f'    end try:\n'
    f'  end if:\n'
    f'end do:\n'
    f'quit:\n'
)

raw = run_maple_script(script)

# ---------------------------------------------------------------------------
# Parse results — output order follows the requested prop_list
# ---------------------------------------------------------------------------
names_in = list(prop_list)
values = []
units = []
texts = []
table = []

recs = {}
for line in raw.splitlines():
    s = line.strip()
    if not s.startswith("REC|"):
        continue
    parts = s.split("|")
    if len(parts) < 3:
        continue
    name = parts[1].strip()
    kind = parts[2].strip()
    payload = parts[3].strip() if len(parts) > 3 else ""
    unit = parts[4].strip() if len(parts) > 4 else ""
    recs[name] = (kind, payload, unit)

for name in names_in:
    kind, payload, unit = recs.get(name, ("missing", "", ""))
    if kind == "num":
        try:
            val = float(payload)
        except ValueError:
            val = None
        values.append(val)
        units.append(unit)
        texts.append(None)
        table.append("%s = %s %s" % (name, val, unit))
    elif kind == "text":
        values.append(None)
        units.append("")
        texts.append(payload)
        table.append("%s = %s" % (name, payload))
    elif kind == "missing":
        values.append(None)
        units.append("")
        texts.append(None)
        table.append("%s = <no record returned>" % name)
    else:
        values.append(None)
        units.append("")
        texts.append(None)
        table.append("%s = <not available>" % name)

debug = "sent %d names, parsed %d records\n" % (len(names_in), len(recs)) + raw
# ---------- end nodemaple_steelprofileproperties ----------
panel_18 = Panel(nodemaple_materialproperties.units)
prop_names = Python3Script(fastener_type=list_item_3, diameter=vl_diameter, producer=vl_producers)  # -> filtered_members, filtered_tree, names_in, values, units, texts, table, debug
# ---------- prop_names: Python ----------
# SPDX-License-Identifier: GPL-3.0-or-later
#
# Copyright (C) 2026 Andreas Zieritz
#
# This program is free software: you can redistribute it and/or modify
# it under the terms of the GNU General Public License as published by
# the Free Software Foundation, either version 3 of the License, or
# (at your option) any later version.
#
# This program is distributed in the hope that it will be useful,
# but WITHOUT ANY WARRANTY; without even the implied warranty of
# MERCHANTABILITY or FITNESS FOR A PARTICULAR PURPOSE.  See the
# GNU General Public License for more details: https://www.gnu.org/licenses/gpl-3.0.txt

"""
NODEMaple Timber Fastener Properties

Fetches the filtered member list and the mechanical properties for a
selected fastener in one Maple process. Mirrors
NODEMaple_MaterialProperties.py, adapted to the fastener hierarchy.

Two modes of operation, depending on the inputs supplied:

A) Filtered member list (outputs `filtered_members`, `filtered_tree`)
   fastener_type + (optional) diameter + (optional) producer
   -> all "producer@product" designations matching the filters
   Leave diameter/producer empty to widen the filter (either/or/both).

B) Mechanical properties (outputs `names_in`, `values`, `units`,
   `texts`, `table`)
   fastener_type + member ("producer@product") + variable list
   -> one record per requested variable
   Variables (from the metadata branch):
     fm, prod, bet, descr, serviceclass, d, l, dh, M_y_Rk, f_ax_k,
     f_head_k, f_tens_k, l1, l3, f_uk, B_max
   - numeric quantities return unit-bearing values (Units:-Split)
   - l (lengths) and dh (head diameters) vary with length ->
     returned as comma-joined, unit-free, rounded TEXT lists
   - d input is optional: "-" (empty) triggers auto-selection inside
     the Maple module (unique diameter with data);
     ls is always auto (shortest available length)

Input:
  fastener_type : "Nail", "Screw", "Bolt", "Dowel" (from types output)
  diameter      : number, e.g. 6.2 (optional - empty widens the filter;
                  in mode B empty selects the unique diameter)
  producer      : producer name (optional - empty widens the filter)
  member        : "producer@product" (mode B; optional - mode A only
                  needs type plus filters)
  prop_names    : list of variable names to fetch (List Access!)
  maple_version : Maple year, e.g. "2026" (ignored if MAPLE env var is set)

Output:
  filtered_members : flat list of members matching type+diameter/producer
  filtered_tree    : same, as a single-branch tree
  names_in         : echo of the requested variable names (ordered)
  values           : parallel list of numeric values (None for text)
  units            : parallel list of unit strings ("" where none)
  texts            : parallel list of text values (None for numeric)
  table            : display list, "name = value unit" one line per variable
  debug            : raw Maple output, preceded by a send/receive summary
"""

import os
import subprocess
import Grasshopper
from Grasshopper.Kernel.Data import GH_Path

# ---------------------------------------------------------------------------
# Configuration
# ---------------------------------------------------------------------------
if os.environ.get("MAPLE"):
    MAPLE_ROOT = os.environ["MAPLE"]
else:
    MAPLE_ROOT = os.path.join(r"C:\Program Files", f"Maple {maple_version}")

MAPLE_PATH = os.path.join(MAPLE_ROOT, "bin.X86_64_WINDOWS", "cmaple.exe")

def run_maple_script(script, timeout=60):
    """Run a Maple script in a fresh cmaple process and return its output."""
    env = dict(os.environ)
    env["MAPLE"] = MAPLE_ROOT
    env["PATH"] = os.path.join(MAPLE_ROOT, "bin.X86_64_WINDOWS") + \
        os.pathsep + env.get("PATH", "")

    proc = subprocess.Popen(
        [MAPLE_PATH, "-q"],
        stdin=subprocess.PIPE, stdout=subprocess.PIPE,
        stderr=subprocess.STDOUT, text=True,
        cwd=os.path.join(MAPLE_ROOT, "bin.X86_64_WINDOWS"),
        env=env,
        creationflags=subprocess.CREATE_NO_WINDOW)

    out, _ = proc.communicate(input=script, timeout=timeout)
    return out

# ---------------------------------------------------------------------------
# Input normalisation
# ---------------------------------------------------------------------------
def norm_str(x):
    """Trim and strip quotes from an input string; '' -> '-' (wildcard)."""
    if x is None:
        return "-"
    s = str(x).strip().strip('"').strip("'").strip()
    return s if s else "-"

def norm_num(x):
    """Normalise a numeric input; empty -> '-' (auto inside Maple)."""
    if x is None:
        return "-"
    s = str(x).strip().strip('"').strip("'").strip()
    if not s:
        return "-"
    try:
        return str(float(s))
    except ValueError:
        return s

ftype = norm_str(fastener_type)
d_in  = norm_num(diameter)
p_in  = norm_str(producer)
m_in  = norm_str(member)

# Diameter argument for Maple statements: a bare number when given
# (e.g. 6.2), or the quoted string "-" when empty. Inserting a bare '-'
# would be a Maple syntax error (unary minus without operand).
if d_in == "-":
    d_arg = '"-"'
else:
    d_arg = d_in

# Normalise the variable name list.
prop_list = []
for p in (prop_names if prop_names else []):
    s = str(p).strip().strip('"').strip("'")
    if s:
        prop_list.append(s)

# ---------------------------------------------------------------------------
# Script assembly
# ---------------------------------------------------------------------------
script_lines = [
    "kernelopts(printbytes=false):",
    "interface(prettyprint=0):",
]

# --- Mode A: filtered member list -----------------------------------------
script_lines += [
    f'FMEM := NODETimberFasteners:-Property("{ftype}", {d_arg}, "{p_in}", "members"):',
    "for e in FMEM do",
    '  printf("MEM|%s\\n", e):',
    "end do:",
]

# --- Mode B: mechanical property records ----------------------------------
if prop_list and m_in != "-":
    # Member supplied AND variables requested -> fetch values.
    # Quoted list literal — quote every name for uniformity with
    # NODEMaple_MaterialProperties.py.
    maple_list = "[" + ", ".join('"%s"' % p for p in prop_list) + "]"
    script_lines += [
        f'vars := {maple_list}:',
        "for i from 1 to numelems(vars) do",
        "  pname := vars[i]:",
        "  try",
        f'    pval := NODETimberFasteners:-Property("value", "{ftype}", "{m_in}", {d_arg}, "-", pname):',
        "  catch:",
        '    printf("REC|%s|skip|\\n", pname):',
        "    next;",
        "  end try;",
        "  if type(pval, string) then",
        '    printf("REC|%s|text|%s\\n", pname, pval):',
        "  else",
        "    try",
        "      q := Units:-Split(pval):",
        '      printf("REC|%s|num|%a|%a\\n", pname, evalf(q[1]), q[2]):',
        "    catch:",
        "      try",
        '        printf("REC|%s|num|%a|\\n", pname, evalf(pval)):',
        "      catch:",
        '        printf("REC|%s|skip|\\n", pname):',
        "      end try:",
        "    end try:",
        "  end if;",
        "end do:",
    ]

script_lines.append("quit:")
script = "\n".join(script_lines) + "\n"

raw = run_maple_script(script)

# ---------------------------------------------------------------------------
# Parse results
# ---------------------------------------------------------------------------
filtered_members = []
recs = {}

for line in raw.splitlines():
    s = line.strip()
    if s.startswith("MEM|"):
        entry = s.split("|", 1)[1].strip().strip('"')
        if entry:
            filtered_members.append(entry)
    elif s.startswith("REC|"):
        parts = s.split("|")
        if len(parts) < 3:
            continue
        name = parts[1].strip()
        kind = parts[2].strip()
        payload = parts[3].strip() if len(parts) > 3 else ""
        unit = parts[4].strip() if len(parts) > 4 else ""
        recs[name] = (kind, payload, unit)

# Single-branch tree for the filtered list
filtered_tree = Grasshopper.DataTree[object]()
if filtered_members:
    filtered_tree.AddRange(filtered_members, GH_Path(0))

# Property records — output order follows the requested prop_list
names_in = list(prop_list)
values = []
units = []
texts = []
table = []

for name in names_in:
    kind, payload, unit = recs.get(name, ("missing", "", ""))
    if kind == "num":
        try:
            val = float(payload)
        except ValueError:
            val = None
        values.append(val)
        units.append(unit)
        texts.append(None)
        table.append("%s = %s %s" % (name, val, unit))
    elif kind == "text":
        values.append(None)
        units.append("")
        texts.append(payload)
        table.append("%s = %s" % (name, payload))
    elif kind == "missing":
        values.append(None)
        units.append("")
        texts.append(None)
        table.append("%s = <no record returned>" % name)
    else:
        values.append(None)
        units.append("")
        texts.append(None)
        table.append("%s = <not available>" % name)

debug = ("filters: type=%s d=%s producer=%s member=%s, sent %d vars, "
         "got %d members, parsed %d records\n"
         % (ftype, d_in, p_in, m_in, len(names_in),
            len(filtered_members), len(recs))) + raw
# ---------- end prop_names ----------
vl_properties = ValueList({"f_m,k": "14.0 Units:-Unit(N/mm^2)", "f_t,0,k": "7.2 Units:-Unit(N/mm^2)", "f_t,90,k": "0.4 Units:-Unit(N/mm^2)", "f_c,0,k": "16.0 Units:-Unit(N/mm^2)", "f_c,90,k": "2.0 Units:-Unit(N/mm^2)", "f_v,k": "3.0 Units:-Unit(N/mm^2)", "f_r,k": "0.8 Units:-Unit(N/mm^2)", "E_m,0,mean": "7000.0 Units:-Unit(N/mm^2)", "E_m,0,k": "4700.0 Units:-Unit(N/mm^2)", "E_m,90,mean": "230.0 Units:-Unit(N/mm^2)", "E_90,05": "0.0 1", "G_mean": "440.0 Units:-Unit(N/mm^2)", "G_0,05": "0.0 1", "G_r,mean": "0.0 1", "G_r,05": "0.0 1", "rho_k": "290.0 Units:-Unit(kg/m^3)", "rho_mean": "350.0 Units:-Unit(kg/m^3)"}, selected="f_m,k")
text_trim = TextTrim(Text=text_split, Start=True, End=True)
populate_valuelist_6 = PopulateValueList(list_name="VL_member", names=tree_branch_7, values=tree_branch_7)  # -> out, a; inputs list_name: String, names: list of String, values: list of String; same code as populate_valuelist
panel_19 = Panel(nodemaple_steelprofileproperties.names_in)
list_item_4 = ListItem(List=text_trim, Index=1, Wrap=True)  # -> flatten(Item)

# ---- group: Value List Definitions Materials
populate_valuelist_7 = PopulateValueList(list_name="VL_material", names=nodemaple_materialdefinitions.categories)  # -> out, a; inputs list_name: String, names: list of String, values: list of String; same code as populate_valuelist
populate_valuelist_8 = PopulateValueList(list_name="VL_grade", names=panel_8, values=panel_8)  # -> out, a; inputs list_name: String, names: list of String, values: list of String; same code as populate_valuelist
populate_valuelist_9 = PopulateValueList(list_name="VL_properties", names=panel_9, values=list_item_4)  # -> out, a; inputs list_name: String, names: list of String, values: list of String; same code as populate_valuelist

# ----
panel_20 = Panel(nodemaple_materialproperties.texts)
panel_21 = Panel(prop_names.debug)
panel_22 = Panel(nodemaple_steelprofileproperties.table)
panel_23 = Panel(nodemaple_steelprofileproperties.texts)
panel_24 = Panel(vl_properties)
panel_25 = Panel(nodemaple_materialproperties.table)
panel_26 = Panel(nodemaple_steelprofileproperties.values)
panel_27 = Panel(prop_names.values)
panel_28 = Panel(prop_names.units)
panel_29 = Panel(prop_names.table)
panel_30 = Panel(prop_names.texts)
panel_31 = Panel(prop_names.filtered_members)
panel_32 = Panel(prop_names.names_in)
panel_33 = Panel(prop_names.filtered_tree)
panel_34 = Panel(nodemaple_steelprofileproperties.units)
